# Grasshopper definition udp.gh (Grasshopper 0.9.76)
# plug-ins: Python Interpreter, gHowl

directorypath_with_backslashes_no_spaces = Panel("C:\Users\patri\Desktop\braid-evolution\unity\interactive-braid-evolution\Assets\Geometry\test")  # "DirectoryPath with Backslashes NO SPACES and FileName Minus Extension"
brep = Brep([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])

# ---- group: Network configuration for recieving
ip_to_receive_on_this_computer = Panel("10.13.1.197")
port_to_receive_on = Panel("8051")
udp = UDPReceiver(Address=ip_to_receive_on_this_computer, Port=port_to_receive_on, Pattern=0)  # -> Info, Data
panel = Panel(udp.Info)

# ----
the_message_coming_from_unity = Panel(udp.Data)

# ---- group: JSON decoder
json_loader = PythonScript(data=udp.Data)  # -> object
# ---------- json_loader: Python ----------
import json 

j = json.loads(data)

object = j
# ---------- end json_loader ----------

# ---- group: Model exporting
model_export = PythonScript(FileNameToSave=directorypath_with_backslashes_no_spaces, Brep=brep, jsonObject=json_loader)  # -> message; inputs Brep: list of Brep
# ---------- model_export: Python ----------
import rhinoscriptsyntax
import Rhino


if(jsonString == "Message from Unity"):
    FILE_NAME = FileNameToSave
    
    for q in range (0,len(Brep)):
      Rhino.RhinoDoc.ActiveDoc.Objects.AddBrep(Brep[q], Rhino.DocObjects.ObjectAttributes())
    
    rhinoscriptsyntax.Command("SelAll")
    rhinoscriptsyntax.Command("-Export " + FILE_NAME + ".obj y=n Enter Enter") #y=n turns off silly Y/Z axis swap! Use no spaces in the file path.
    rhinoscriptsyntax.Command("Delete Enter")
    
    message = True
else :
    message = False
# ---------- end model_export ----------

# ---- group: JSON encoder
json_encoder = PythonScript(exportSucess=model_export, jsonObject=json_loader)  # -> shouldExport, jsonString; inputs exportSucess: Boolean
# ---------- json_encoder: Python ----------
import json 



jsonString = json.dumps({
    'name': 'new_model', 
    'generation':'2', 
    'sucess': exportSucess
})
# ---------- end json_encoder ----------

# ---- group: Network configuration for sending
ip_to_send_to = Panel("10.13.1.197")
port_to_send_to = Panel("8050")
udp_2 = UDPSender(Address=ip_to_send_to, Port=port_to_send_to, Pattern=0, Data=json_encoder.jsonString)
panel_2 = Panel(udp_2)
